# Requirement set crs_controller_requirements (R2025b)
crs_controller サブシステム機能要件

## 1 [#1] DriverSwRequest: ドライバースイッチ要求の正規化 (Container)
ドライバースイッチ入力（enbl, cncl, set, resume, inc, dec）を処理し、運転者の意図を表す統一要求信号 reqDrv に変換する。
Rationale: 物理スイッチの押下パターンは多様かつ同時押しが発生しうるため、優先度付きのスイッチング論理で一意な要求へ正規化し、後段の状態機械が単一の入力で制御判断できるようにする必要がある。

### 1.1 [#4] decrement: デクリメント要求の生成 (Container)
dec_sw が有効のとき、内部カウンタで計測した押下継続時間に基づき短押し用または長押し用のデクリメント要求を dec_out として出力する。スイッチが無効のときは else 入力をそのまま通過させる。
Rationale: デクリメントスイッチによる速度減少操作では、単ステップ調整（短押し）と連続的な高速デクリメント（長押し）を区別する必要がある。これにより運転者は一つの物理スイッチで細かい調整と大きな調整の両方を行える。押下時間の検出がなければ、すべての押下が同一の単ステップ応答となってしまう。

#### 1.1.1 [#7] counter (in decrement): デクリメントスイッチ継続押下カウンタ
入力（In1）が有効（非ゼロ）である連続サンプル数をカウントし、入力が無効になるとカウントをゼロにリセットする。
Rationale: decrement サブシステムは適切な速度変化量を選択するために短押しと長押しを区別する必要がある。有効入力サンプルを積算するカウンタが、この判断に必要な離散時間ステップ単位の押下継続時間を提供する。

#### 1.1.2 [#41] デクリメント操作の列挙値定義
dec 操作の出力候補値（Dec_Short / Dec_Middle / Dec_Long）および 前サンプル比較用の参照値（Dec_Short / Dec_Middle / Dec_Long）を EnumeratedConstant ブロックとして定義する。

#### 1.1.3 [#42] デクリメント短押し検出
dec_sw が true のとき reqMode.Dec_Short を出力する。dec_sw が false のときは else 入力（inc/dec 以外のスイッチ要求）をパススルーする。

#### 1.1.4 [#43] デクリメント中押し昇格判定
前サンプル要求が reqMode.Dec_Short または reqMode.Dec_Middle である（RelationalOperator × 2 → OR）かつ dec_sw が継続して true（AND）の場合に reqMode.Dec_Middle を出力する。これによりスイッチの押し続けに伴う段階的昇格を実現する。

#### 1.1.5 [#44] デクリメント長押し状態の継続
前サンプル要求が reqMode.Dec_Long（RelationalOperator）かつ dec_sw が継続して true（AND）の場合に reqMode.Dec_Long を維持する。これにより長押し状態を次サンプルへ引き継ぎ、スロットル連続変化を実現する。

### 1.2 [#5] increment: インクリメント要求の生成 (Container)
inc_sw が有効のとき、内部カウンタで計測した押下継続時間に基づき短押し用または長押し用のインクリメント要求を inc_out として出力する。スイッチが無効のときは else 入力をそのまま通過させる。
Rationale: インクリメントスイッチによる速度増加操作では、単ステップ調整（短押し）と連続的な高速インクリメント（長押し）を区別する必要がある。これにより運転者は一つの物理スイッチで細かい調整と大きな調整の両方を行える。押下時間の検出がなければ、すべての押下が同一の単ステップ応答となってしまう。

#### 1.2.1 [#8] counter (in increment): インクリメントスイッチ継続押下カウンタ
入力（In1）が有効（非ゼロ）である連続サンプル数をカウントし、入力が無効になるとカウントをゼロにリセットする。
Rationale: increment サブシステムは適切な速度変化量を選択するために短押しと長押しを区別する必要がある。有効入力サンプルを積算するカウンタが、この判断に必要な離散時間ステップ単位の押下継続時間を提供する。

#### 1.2.2 [#45] インクリメント操作の列挙値定義
inc 操作の出力候補値（Inc_Short / Inc_Middle / Inc_Long）および 前サンプル比較用の参照値を EnumeratedConstant ブロックとして定義する。

#### 1.2.3 [#46] インクリメント短押し検出
inc_sw が true のとき reqMode.Inc_Short を出力する。inc_sw が false のときは else 入力をパススルーする。

#### 1.2.4 [#47] インクリメント中押し昇格判定
前サンプル要求が reqMode.Inc_Short または reqMode.Inc_Middle である（RelationalOperator × 2 → OR）かつ inc_sw が継続して true（AND）の場合に reqMode.Inc_Middle を出力する。

#### 1.2.5 [#48] インクリメント長押し状態の継続
前サンプル要求が reqMode.Inc_Long（RelationalOperator）かつ inc_sw が継続して true（AND）の場合に reqMode.Inc_Long を維持する。

### 1.3 [#6] doNot Repeat: 連続重複要求の除去 (Container)
入力要求（reqDrInv）が前回の要求と同じ場合、出力を「要求なし」の値に置き換える。異なる場合は入力をそのまま reqDrv として出力する。
Rationale: 後段の状態機械は同じ要求を連続ステップで再処理してはならない。重複除去がなければ、スイッチを押し続けた場合に連続的なボタン押下と解釈され、意図しない状態遷移の繰り返しが発生する。

#### 1.3.1 [#49] 繰り返し禁止対象タイプの判定
現在の要求が Cancel / Cruise / Set / ResumeReq のいずれかであるかを RelationalOperator × 4 → OR で判定する。これらのモードは連続入力を抑制すべき "モメンタリ操作" に相当する。

#### 1.3.2 [#50] 前サンプル入力の保持（doNot Repeat）
1 サンプル前の入力要求（reqDrInv）を Delay で保持し、次サンプルの同値比較（前サンプルとの同一性チェック）に使用する。

#### 1.3.3 [#51] 前サンプルとの同値判定
現在の要求（reqDrInv）と Delay の出力（前サンプル）が同値かを RelationalOperator で判定する。同値であれば「同一スイッチが連続して押されている」ことを示す。

#### 1.3.4 [#52] 重複入力時の NoRequest 出力
繰り返し禁止対象タイプ（OR 出力）かつ前サンプルと同値（AND）の場合に reqMode.NoRequest を出力する。それ以外のときは reqDrInv をパススルーする（Switch）。

### 1.4 [#38] 優先度選択定数の定義
cncl/enbl/set/resume の各スイッチ操作と無入力に対応する reqMode 列挙値（Cancel / Cruise / Set / ResumeReq / NoRequest）を EnumeratedConstant ブロックとして定義する。これらの値が優先度付き Switch チェーンの入力定数となる。

### 1.5 [#39] 優先度付きスイッチ選択チェーン
cncl > enbl > set > resume の優先度順に Switch ブロックを直列に接続し、有効な入力のうち最高優先度の reqMode を選択する。いずれの入力も false のときは dec/inc サブシステムの出力をパススルーする。

### 1.6 [#40] 前サンプル要求の保持（DriverSwRequest）
1 サンプル前の reqDrv を Delay で保持する。この値を doNot Repeat サブシステムおよび dec/inc サブシステムの prev_req（前サンプル要求）として供給する。

## 2 [#2] CruiseControlMode: クルーズコントロール動作モード管理
reqDrv、brakeP、vehSp、key、gear を入力として、クルーズコントロールの動作状態（status）と制御モード（mode）を決定する。
Rationale: 走行条件（車速範囲、ブレーキ操作、キーON/OFF、ギア位置）に応じた安全な状態遷移管理が必要であり、不正な状態への遷移を防ぐことで機能安全要件を満たす。

### 2.1 [#9] disableCaseDetection: CC強制無効化条件の判定
key（キーON/OFF）、gear（ギア位置）、brakeP（ブレーキ圧）を入力として、クルーズコントロールを強制的に無効化すべき状態かどうかを示す disable_flag を出力する。
Rationale: キーオフ・非走行ギア・ブレーキ操作はCCの継続を危険にするため、これらの条件を一元的に検出して後段のモード判定に伝える必要がある。

### 2.2 [#10] getActStatus: CC有効化ステータスの生成
現在の制御モード（mode）を入力として、クルーズコントロールが有効化されているかどうかを示す cc_act_status を出力する。
Rationale: 上位システムがCCの有効化状態を知るためにはモード列挙値から二値ステータスへの変換が必要であり、他のサブシステムがモード値を直接参照せずに有効化状態を判断できるようにする必要がある。

### 2.3 [#11] outOfRange: 車速範囲外判定
車速（vehSp）が制御可能範囲（tsp_min ～ tsp_max）外にある場合に真となる outRange フラグを出力する。
Rationale: クルーズコントロールは一定の車速範囲内でのみ安全に動作できる。範囲外車速での有効化・アクティブ化を禁止するため、車速の範囲判定を専用サブシステムとして分離する必要がある。

### 2.4 [#12] opMode: 動作モードの決定
ドライバー要求（reqDrv）、車速範囲外フラグ（outRange）、前ステップのモード（mode_prev）を入力として、クルーズコントロールの動作モード（mode）を決定する。
Rationale: CCの各動作モード（無効・有効・アクティブ・再開）への遷移は複数条件の組み合わせで決まるため、遷移ロジックを専用サブシステムに集約することで状態管理の整合性を保証する必要がある。

#### 2.4.1 [#13] activateCondition: アクティブモード遷移条件の統合判定
reqDrv、mode_prev、outof_range を入力として、現在のステップでアクティブモードへ遷移すべきかどうかを示す yesno フラグを出力する。
Rationale: アクティブモードへの遷移はアクティブ化要求・長押し待機・継続条件・再開条件の論理和で構成されるため、これらの部分条件を統合してアクティブ化の最終判定を一か所で行う必要がある。

##### 2.4.1.1 [#17] activate: アクティブ化要求の検出
reqDrv がアクティブ化要求を示し、かつ車速が範囲内（outof_range = false）のとき、yesno = true を出力する。
Rationale: アクティブ化は「アクティブ化スイッチ押下」かつ「車速が有効範囲内」の2条件の積であるため、これを独立したサブシステムで判定することで条件の追加・変更を局所化できる。

##### 2.4.1.2 [#18] keepActivated: アクティブ状態の継続条件判定
reqDrv と mode_prev から、アクティブ状態を継続すべき条件が成立するかを示す yesno を出力する。
Rationale: set/resume/inc/dec等の要求が入力された場合にアクティブ状態を維持するロジックを分離することで、アクティブ継続条件の変更が他の遷移ロジックに影響しないようにする必要がある。

##### 2.4.1.3 [#19] resumeToActive: Resume状態からActiveへの遷移条件判定
前ステップのモード（mode_prev）がResume状態であった場合に yesno = true を出力する。
Rationale: Resume状態から次ステップでActive状態へ自動遷移するルールを独立したサブシステムに分離することで、Resumeモードの遷移仕様を明確に表現し保守性を高める必要がある。

##### 2.4.1.4 [#20] waitingForButtonHolding: ボタン長押し待機状態の判定
reqDrv が長押し待機に対応する要求値のいずれかと一致する場合に yesno = true を出力する。
Rationale: 長押し操作中にアクティブモードへの遷移を継続させるためには長押し中の要求値を検出する専用ロジックが必要であり、これを分離することで長押し判定の定義を一か所に集約できる。

#### 2.4.2 [#14] disableCondition: 無効化条件の統合判定
CCスイッチ要求（ccsw_request）と前ステップのモード（mode_prev）から、クルーズコントロールを無効化すべきかを示す yesno フラグを出力する。
Rationale: 無効化はCC停止操作とアクティブ時のみ有効なボタン操作の論理和で決まるため、各判定を子サブシステムに分離しつつ最終判定をここで統合する必要がある。

##### 2.4.2.1 [#21] turnOffCruise: CC停止要求の検出
ccsw_request がキャンセル要求であり、かつ mode_prev が非Disabled状態のとき、yesno = true を出力する。
Rationale: 運転者がCCキャンセルを操作したとき、かつシステムが既に無効でない場合に限り無効化を発動することで、二重無効化や不要なモード遷移を防ぐ必要がある。

##### 2.4.2.2 [#22] buttonsShouldBeCalledWhenActivated: アクティブ時限定ボタン操作の検出
mode_prev がアクティブ状態であり、かつ ccsw_request が非null・非キャンセル要求のとき yesno = true を出力する。
Rationale: inc/dec/set等のボタン操作はアクティブモード中にのみ有効とすべきであり、他のモードでの誤操作による意図しない遷移を防ぐためにアクティブ時限定の有効化条件を独立して判定する必要がある。

#### 2.4.3 [#15] enableCondition: 有効化条件の統合判定
reqDrv と mode_prev から、有効化（Enable）モードへ遷移すべきかを示す yesno フラグを出力する。
Rationale: 有効化条件はSetスイッチ押下と有効化キャンセル条件の組み合わせで決まるため、各判定を子サブシステムに分離して論理統合をここで行う必要がある。

##### 2.4.3.1 [#23] pressSetSw: Setスイッチ押下の検出
reqDrv がSetスイッチ押下に対応する要求値と一致する場合に yesno = true を出力する。
Rationale: Setスイッチ押下の検出を独立したサブシステムに分離することで、スイッチ種別の変更や追加をこのブロックのみの修正で対応可能にする必要がある。

##### 2.4.3.2 [#24] cancelActivation: 有効化キャンセル条件の判定
reqDrv がキャンセル操作を示し、かつ mode_prev がEnable状態のとき、有効化をキャンセルすべきであることを示す yesno = true を出力する。
Rationale: 有効化操作が開始された後にキャンセル操作が行われた場合にEnable状態を脱出させる必要がある。この判定を分離することで有効化キャンセルの条件を明確に定義し保守性を高める。

#### 2.4.4 [#16] resumeCondition: 再開条件の統合判定
reqDrv と mode_prev から、再開（Resume）モードへ遷移すべきかを示す yesno フラグを出力する。
Rationale: 再開条件はEnable状態からの再開操作とキャンセル済み状態の検出の論理和で決まるため、各判定を子サブシステムで評価し最終判定をここで統合する必要がある。

##### 2.4.4.1 [#25] enableToResume: Enable状態からの再開条件判定
reqDrv がResume要求であり、かつ mode_prev がEnable状態のとき、yesno = true を出力する。
Rationale: Enable状態からResume操作によってResume状態へ遷移するパスを独立したサブシステムで判定することで、この遷移条件の仕様を局所化し変更の影響範囲を限定する必要がある。

##### 2.4.4.2 [#26] hasCanceled: キャンセル状態の検出
前ステップのモード履歴に基づき、直前にキャンセル操作が行われた状態かどうかを示す yesno フラグを遅延と論理演算を用いて生成する。
Rationale: Resume操作を有効にするためには「一度Disableになった」という過去状態を記憶する必要がある。この状態記憶を独立したサブシステムに分離することで、キャンセル履歴の検出ロジックを他の遷移条件から独立して管理できる。

#### 2.4.5 [#27] IncrementDecrement: インクリメント/デクリメント操作時のモード選択
reqDrv がインクリメントまたはデクリメント要求のいずれかと一致するとき、その要求に対応する動作モード値を mode として出力する。いずれにも一致しない場合は mode_prev をそのまま出力する。
Rationale: inc/dec 操作によるモード遷移は他の有効化・無効化・再開条件とは独立したパスであるため、専用のサブシステムで要求値とモード値の対応関係を管理することで、遷移ルールの変更を局所化し保守性を高める必要がある。

## 3 [#3] TargetSpeedThrottle: 目標速度とスロットル指令値の算出
制御モード（mode）、車速（vehSp）、ドライバースロットル（throtDrv）を入力として、目標速度（targetSp）とクルーズコントロール用スロットル指令値（throtCC）を算出する。
Rationale: モードに応じて制御則（無効・有効・アクティブ・再開）を切り替え、適切なスロットル出力を生成することで、車速を目標値に追従させる制御ループを実現する必要がある。

### 3.1 [#28] activated: アクティブモード時の目標速度とスロットル算出
CCがアクティブモードのとき有効化され、目標速度（targetSp）とスロットル指令値（throttleCC）を算出する。targetSpIn（前ステップ目標速度）、mode（現在モード）、vehSp（車速）、throtDrv（ドライバースロットル）を入力として使用する。
Rationale: アクティブモード中は車速を目標速度に追従させるPIフィードバック制御が必要であり、他のモードとは異なる出力演算が求められるため、専用の有効化サブシステムとして分離する必要がある。

#### 3.1.1 [#33] getNewTargetSpeed: inc/dec操作による目標速度の更新
現在の目標速度（targetSpIn）と動作モード（mode）を入力として、inc/dec操作に対応する速度増減量（target_inc_short, target_inc_hold, target_dec_short, target_dec_hold）を加減算し、制御範囲（tsp_min〜tsp_max）に飽和させた新しい目標速度（targetSp）を出力する。
Rationale: インクリメント/デクリメント操作による目標速度の更新は短押し・長押しそれぞれの増減量パラメータと範囲制限を伴うため、この演算を専用サブシステムに分離することで目標速度更新ロジックの変更を局所化できる。

#### 3.1.2 [#34] getThrottleValue: スロットル指令値の生成
目標速度（targetSpIn）、車速（vehSp）、ドライバースロットル（throtDrv）を入力として、PI制御またはドライバースロットルのいずれかを選択し、範囲制限（throt_min〜throt_max）を適用したスロットル指令値を出力する。
Rationale: スロットル指令値の生成にはPI制御の適用可否判定と飽和処理が必要であり、これらを専用サブシステムに集約することでスロットル演算ロジックの独立した管理と検証を可能にする必要がある。

##### 3.1.2.1 [#35] PI controller: 車速追従PIフィードバック制御
目標速度（targetSpIn）と車速（vehSp）の偏差を入力として、比例ゲイン（Kp）と積分項（サンプル時間Ts）によるPI演算でスロットル指令値（throt）を出力する。Enable信号によりアクティブ制御を切り替える。
Rationale: 車速を目標速度に追従させるためにはフィードバック制御が必要であり、定常偏差を除去する積分項を含むPI制御をEnable付きで実装することで、非アクティブ時の積分器の不要な動作を防ぐ必要がある。

##### 3.1.2.2 [#36] UsePI: PI制御適用条件の判定
PIコントローラ出力（throtPI）、目標速度（targetSpIn）、車速（vehSp）、ドライバースロットル（throtDrv）を入力として、PI制御値がドライバースロットル以上かつ目標速度が車速より大きい場合に yesno = true を出力する。
Rationale: PI制御への切り替えは「PIが有益な方向に制御している」場合に限定すべきであり、そうでない場合はドライバースロットルを優先することで不必要な介入による違和感や安全リスクを防ぐ必要がある。

### 3.2 [#29] disabled: 無効モード時の安全出力の保証
CCが無効（Disabled）モードのとき有効化され、目標速度を最小値（tsp_min）、スロットル指令値をドライバースロットル（throtDrv）そのままで出力する。
Rationale: 無効モード中はCCがスロットルに介入せず目標速度も意味を持たないため、安全な初期値（tsp_min）とドライバースロットルのパスルーを保証する専用サブシステムが必要である。

### 3.3 [#30] enabled: 有効モード時の車速保持とスロットルパスルー
CCが有効（Enabled）モードのとき有効化され、目標速度として現在の車速（vehSp）を、スロットル指令値としてドライバースロットル（throtDrv）をそのまま出力する。
Rationale: 有効化直後はまだアクティブ制御に移行していないため、目標速度を現在車速に設定してアクティブ化時のスムーズな引き継ぎを準備し、スロットルはドライバーに委ねる必要がある。

### 3.4 [#31] targetSpeed: 基準目標速度の状態管理
Enable・Activate・resume フラグと前ステップ目標速度（targetSp_in）を入力として、次ステップの基準目標速度（targetSp_pre）を生成する。再開時は保存済み速度を復元し、それ以外は前ステップ値を保持する。
Rationale: 目標速度はモード遷移ごとに適切な初期値を設定する必要があるため、目標速度の状態管理を専用サブシステムに集約することで遷移ごとの初期化ロジックを一元管理する必要がある。

#### 3.4.1 [#37] storeSpeed: Enable時の目標速度の保存
Enable信号がアサートされているとき、入力された目標速度（targetSp_prev）をそのまま保持して stored_targetSp として出力する。
Rationale: 再開（Resume）操作時に以前の目標速度を復元するためには、Enable状態中の目標速度を保存しておく専用サブシステムが必要である。これにより再開時に車速を元の設定速度へ正確に追従させることができる。

### 3.5 [#32] toBoolean: モード列挙値の二値フラグへの変換
動作モード（mode）の列挙値を入力として、isDisabled・isEnabled・isResumed・isActivated の4つの二値フラグに変換して出力する。
Rationale: 下流の有効化サブシステムへの制御信号は二値論理で制御されるため、列挙型モード値を各モードに対応するブール値に変換する専用サブシステムが必要である。これによりモード判定ロジックの重複を排除できる。